# Dynamo graph AutoDIMENSION_Dynamo - ver3.dyn (Dynamo 3.6.1.9895)
# packages: DynamoIronPython3 1.6.0

activeView = Document.ActiveView()  # unwired: document
categories = Categories("OST_Walls")
all_elements_of_category = ElementsOfCategory(Category=categories)
code_block = CodeBlock { 600; }
python_script = Python(IN[1]=activeView, IN[2]=all_elements_of_category, IN[3]=code_block)  # IronPython3; unwired: IN[0]
# ---------- python_script.python (140 lines) ----------
import clr

clr.AddReference("RevitAPI")
clr.AddReference("RevitServices")

import Autodesk.Revit.DB as DB
from RevitServices.Persistence import DocumentManager
from RevitServices.Transactions import TransactionManager

# Inicialização do documento e vista ativa
doc = DocumentManager.Instance.CurrentDBDocument
view = doc.ActiveView

# Tratamento dos inputs do Dynamo
raw = IN[2] if isinstance(IN[2], list) else [IN[2]]
elementos = [el.InternalElement if hasattr(el, "InternalElement") else el 
             for el in raw if el is not None]

# Configuração de distanciamento das cotas (em mm para pés)
offset_mm = float(IN[3]) if IN[3] is not None else 600.0
off = offset_mm / 304.8
dist_entre_linhas = 400.0 / 304.8 # Distância entre a cota parcial e a cota total

# Filtrar apenas paredes válidas
paredes = [el for el in elementos if isinstance(el, DB.Wall) and el.Location is not None]

dimensoes_criadas = []
log = []

todos_pts = []
x_faces = []
y_faces = []

# 1. Coleta direcionada usando apenas as superfícies principais das paredes
for p in paredes:
    try:
        c = p.Location.Curve
        if isinstance(c, DB.Line):
            todos_pts.append(c.GetEndPoint(0))
            todos_pts.append(c.GetEndPoint(1))
            
        # Coleta apenas as referências das faces externas e internas brutas
        ext_refs = DB.HostObjectUtils.GetSideFaces(p, DB.ShellLayerType.Exterior)
        int_refs = DB.HostObjectUtils.GetSideFaces(p, DB.ShellLayerType.Interior)
        refs_parede = list(ext_refs) + list(int_refs)
        
        for r in refs_parede:
            face = p.GetGeometryObjectFromReference(r)
            if isinstance(face, DB.PlanarFace):
                normal = face.FaceNormal
                # Separação estrita por ortogonalidade
                if abs(normal.X) > 0.99 and abs(normal.Y) < 0.01:
                    x_faces.append((face.Origin.X, r))
                elif abs(normal.Y) > 0.99 and abs(normal.X) < 0.01:
                    y_faces.append((face.Origin.Y, r))
    except Exception as e:
        continue

if todos_pts:
    x_min = min(pt.X for pt in todos_pts)
    x_max = max(pt.X for pt in todos_pts)
    y_min = min(pt.Y for pt in todos_pts)
    y_max = max(pt.Y for pt in todos_pts)
    
    try: z = view.GenLevel.Elevation
    except: z = 0.0

    # Função para agrupar e eliminar linhas coincidentes ou fantasmas (tol = 2cm)
    def consolidar_linhas(lista_faces, tol=0.06):
        if not lista_faces: return []
        lista_faces.sort(key=lambda x: x[0])
        filtrados = [lista_faces[0]]
        for item in lista_faces[1:]:
            if abs(item[0] - filtrados[-1][0]) > tol:
                filtrados.append(item)
        return filtrados

    x_limpas = consolidar_linhas(x_faces)
    y_limpas = consolidar_linhas(y_faces)

    # Selecionar o tipo de cota
    dim_type = None
    for dt in DB.FilteredElementCollector(doc).OfClass(DB.DimensionType):
        if "alinhad" in dt.Name.lower() or "linear" in dt.Name.lower():
            dim_type = dt
            break
    if dim_type is None:
        dim_type = DB.FilteredElementCollector(doc).OfClass(DB.DimensionType).FirstElement()

    TransactionManager.Instance.EnsureInTransaction(doc)

    # ==================== EIXO X (COTAS HORIZONTAIS) ====================
    if len(x_limpas) >= 2:
        try:
            # A. Cota Parcial (Segmentada)
            refs_x_parcial = DB.ReferenceArray()
            for coord, ref in x_limpas: refs_x_parcial.Append(ref)
            
            p1_p = DB.XYZ(x_limpas[0][0], y_min - off, z)
            p2_p = DB.XYZ(x_limpas[-1][0], y_min - off, z)
            linha_x_p = DB.Line.CreateBound(p1_p, p2_p)
            dimensoes_criadas.append(doc.Create.NewDimension(view, linha_x_p, refs_x_parcial, dim_type))
            
            # B. Cota Total (Apenas extremidades para limpeza visual)
            refs_x_total = DB.ReferenceArray()
            refs_x_total.Append(x_limpas[0][1])
            refs_x_total.Append(x_limpas[-1][1])
            
            p1_t = DB.XYZ(x_limpas[0][0], y_min - off - dist_entre_linhas, z)
            p2_t = DB.XYZ(x_limpas[-1][0], y_min - off - dist_entre_linhas, z)
            linha_x_t = DB.Line.CreateBound(p1_t, p2_t)
            dimensoes_criadas.append(doc.Create.NewDimension(view, linha_x_t, refs_x_total, dim_type))
        except Exception as e: log.append(f"Erro no Eixo X: {str(e)}")

    # ==================== EIXO Y (COTAS VERTICAIS) ====================
    if len(y_limpas) >= 2:
        try:
            # A. Cota Parcial (Segmentada)
            refs_y_parcial = DB.ReferenceArray()
            for coord, ref in y_limpas: refs_y_parcial.Append(ref)
            
            p1_p = DB.XYZ(x_min - off, y_limpas[0][0], z)
            p2_p = DB.XYZ(x_min - off, y_limpas[-1][0], z)
            linha_y_p = DB.Line.CreateBound(p1_p, p2_p)
            dimensoes_criadas.append(doc.Create.NewDimension(view, linha_y_p, refs_y_parcial, dim_type))
            
            # B. Cota Total (Apenas extremidades)
            refs_y_total = DB.ReferenceArray()
            refs_y_total.Append(y_limpas[0][1])
            refs_y_total.Append(y_limpas[-1][1])
            
            p1_t = DB.XYZ(x_min - off - dist_entre_linhas, y_limpas[0][0], z)
            p2_t = DB.XYZ(x_min - off - dist_entre_linhas, y_limpas[-1][0], z)
            linha_y_t = DB.Line.CreateBound(p1_t, p2_t)
            dimensoes_criadas.append(doc.Create.NewDimension(view, linha_y_t, refs_y_total, dim_type))
        except Exception as e: log.append(f"Erro no Eixo Y: {str(e)}")

    TransactionManager.Instance.TransactionTaskDone()

OUT = [dimensoes_criadas, log]
# ----------------------------------------
code_block_2 = CodeBlock { 1; }
getItemAtIndex = List.GetItemAtIndex(list=python_script, index=code_block_2)
watch = Watch(getItemAtIndex)
code_block_3 = CodeBlock { 0; }
getItemAtIndex_2 = List.GetItemAtIndex(list=python_script, index=code_block_3)
watch_2 = Watch(getItemAtIndex_2)
